# Grasshopper definition angkor.gh (Grasshopper 0.9.14)

wave = Slider(0.5, range=0.5..3)
stroke = Slider(0.2, range=0.2..2)
seed1 = Slider(9, range=2..50)
density = Slider(6, range=1..20)
simmetry = Slider(4, range=1..6)
seed2 = Slider(50, range=2..50)
xy = XYPlane(Origin=Point(0, 0, 0))
num = Number(density)
num_2 = Number(seed2)
num_3 = Number(seed1)
cir = Circle(Plane=xy, Radius=20)
eval = Evaluate(F="(x*2)-0.03", x=stroke)
eval_2 = Evaluate(F="360/x", x=simmetry)
len = Length(Curve=cir)
series = Series(Start=0, Step=eval_2, Count=simmetry)
eval_3 = Evaluate(F="x-10", x=len)
dom = Domain(DomainStart=0, DomainEnd=len)
dom_2 = Domain(DomainStart=10, DomainEnd=eval_3)
random = Random(Range=dom, Number=num, Seed=num_3)
mesh_cylinder_vb = VBScript(x=stroke)  # -> out, A
# ---------- mesh_cylinder_vb: VB ----------
    Dim radius As Double
    Dim height As Double
    radius = x
   
    Dim circle As Circle
    Dim cylinder As Cylinder
    Dim mesh As Mesh
    'New Rhino.Geometry.Circle(
    circle = New Rhino.Geometry.Circle(radius)
    cylinder = New Rhino.Geometry.Cylinder(circle, 1)
    mesh = Rhino.Geometry.Mesh.CreateFromCylinder(cylinder, 1, 9)
    A = RhinoDoc.ActiveDoc.Objects.AddMesh(mesh)
# ---------- end mesh_cylinder_vb ----------
random_2 = Random(Range=dom_2, Number=num, Seed=num_2)
addition = Addition(A=random, B=random_2)
rad = Radians(Degrees=series)  # -> graft(Radians)
hframe = HorizontalFrame(Curve=cir, Parameter=random)
hframe_2 = HorizontalFrame(Curve=cir, Parameter=addition)
ln = Line(StartPoint=hframe, EndPoint=hframe_2)
crv = Curve(ln)
divlength = DivideLength(Curve=crv, Length=eval)  # -> simplify(flatten(Points)), Tangents, Parameters
dist = Distance(PointA=xy, PointB=divlength.Points)
eval_4 = Evaluate(F="0.25 + ((1 + sin(x*y)) / 2)", x=dist, y=wave)
Z = UnitZ(Factor=eval_4)
scale = Scale(Geometry=mesh_cylinder_vb.A, Center=Point(0, 0, 0), Factor=Z)  # -> Geometry, Transform
move = Move(Geometry=scale.Geometry, Motion=divlength.Points)  # -> simplify(flatten(Geometry)), Transform
rotate = Rotate(Geometry=move.Geometry, Angle=rad, Plane=PlaneXY(0, 0, 0))  # -> Geometry, Transform
