# Grasshopper definition voronoi_tiles_pendant_text.gh (Grasshopper 0.9.14)
# plug-ins: WeaverBird

textparam = String("naama")
center_x = Slider(15, range=0..20)
center_y = Slider(14.5, range=0..100)
a0 = Number(0.8)
a1 = Number(4)
a2 = Number(27)
a3 = Number(7)
max_height = Slider(13.6, range=4..30)
max_width = Slider(28, range=5..40)
toggle_bold = BooleanToggle(True)
join = StringJoin(Strings=textparam)
font = String("Comic Sans MS")
cluster = Cluster(
    face=font,
    bold=toggle_bold,
    content=join,
    center_x=center_x,
    center_y=center_y,
    max_height=max_height,
    max_width=max_width)
custom_mesh_settings = SettingsCustom(
    StitchSeams=True,
    SimplePlanes=False,
    Refine=invert(True),
    MinCount=16,
    MaxCount=400,
    AspectRatio=10,
    MaxDistance=0,
    MaxAngle=20,
    MinEdge=0.2,
    MaxEdge=0.8)
extr = Extrude(Base=cluster, Direction=Vector(0, 0, 3))
jagged = SettingsSpeed()
mesh = MeshBrep(Brep=extr, Settings=custom_mesh_settings)
wbsplitquads = WeaverBirdsConstantQuadsSubdivision(MeshCurves=mesh, Level=1, SmoothNakedEdges=1)  # disabled
wbcatmullclark = WeaverBirdsCatmullClarkSubdivision(MeshCurves=mesh, Level=1, SmoothNakedEdges=1)  # disabled
wblaplace = WeaverBirdsLaplacianSmoothing(MeshCurves=mesh, Level=3, SmoothNakedEdges=1, Thin=1)  # -> flatten(OutputMeshCurves)
bbox = BoundingBox(Content=wblaplace, Plane=PlaneXY(0, 0, 0), UnionBox=True)  # -> Box, Box_2; disabled
smesh = SimpleMesh(Brep=bbox.Box)  # disabled
wbfacepolys = WeaverBirdsFacePolylines(Mesh=smesh)  # disabled
all = Geometry(wblaplace)
item = ListItem(List=wbfacepolys, Index=4, Wrap=False)  # disabled
offset = Offset(Curve=item, Distance=-1, Plane=PlaneXY(0, 0, 0), Corners=1)  # disabled
extr_2 = Extrude(Base=offset, Direction=Vector(0, 0, 2.6))  # disabled
cap = CapHoles(Brep=extr_2)  # disabled
bbox_2 = BoundingBox(Content=cap, Plane=PlaneXY(0, 0, 0), UnionBox=True)  # -> Box, Box_2; disabled
mbox = MeshBox(Base=bbox_2.Box, XCount=30, YCount=10, ZCount=20)  # disabled
wblaplace_2 = WeaverBirdsLaplacianSmoothing(MeshCurves=mbox, Level=2, SmoothNakedEdges=1, Thin=1)  # disabled

# ==== cluster Cluster
extrusion_vec = Vector(Vector(0, 0, 4.5))
max_height = ClusterInput()
content = ClusterInput()
center_x = ClusterInput()
face = ClusterInput()
bold = ClusterInput()
max_width = ClusterInput()
bool = Boolean(False)
center_y = ClusterInput()
servers_text_component = Servers_Text_Component(face=face, bold=bold, italics=bool, size=1, content=content)  # -> out, A
# ---------- servers_text_component: VB ----------
    If(size = 0) Then
      size = 1
    End If


    Dim letters_plane As Rhino.Geometry.Plane
    letters_plane = Rhino.Geometry.Plane.WorldXY

    If(face <> Nothing And size > 0 And content <> Nothing) Then
      Dim te As System.Guid
      te = RhinoDoc.ActiveDoc.Objects.AddText(content, letters_plane, size, face, bold, italics)

      Dim txt As Rhino.DocObjects.TextObject
      txt = RhinoDoc.ActiveDoc.Objects.Find(te)

      Dim tt As Rhino.Geometry.TextEntity
      tt = txt.Geometry

      Dim curves() As Rhino.Geometry.Curve
      curves = tt.Explode()

      Dim curvesNum As Integer
      curvesNum = curves.GetUpperBound(0)


      Dim guids(curvesNum) As Guid
      For i As Integer = 0 To curvesNum
        Dim g As Guid
        g = RhinoDoc.ActiveDoc.Objects.AddCurve(curves(i))
        guids(i) = g
      Next
      A = guids
      RhinoDoc.ActiveDoc.Objects.Delete(te, True)
    End If
# ---------- end servers_text_component ----------
Z = UnitZ(Factor=extrusion_vec)
pt = PointXYZ(XComponent=center_x, YComponent=center_y, ZComponent=0, System=PlaneXY(0, 0, 0))
planar = PlanarSrf(Edges=servers_text_component.A)
extr = Extrude(Base=planar, Direction=Z)
cap = CapHoles(Brep=extr)
bbox_points = BboxPoints(C=cap)  # -> center, E, E_2, width, height
expression = Expression(x=max_width, y=max_height, z=bbox_points.width, u=bbox_points.height, Expression="min(x/z , y/u)")
pt_2 = Point(bbox_points.center)
subtraction = Subtraction(A=pt, B=bbox_points.center)
move = Move(Geometry=planar, Motion=subtraction)  # -> Geometry, Transform
scale = Scale(Geometry=move.Geometry, Center=pt, Factor=expression)  # -> Geometry, Transform
G = ClusterOutput(scale.Geometry)

# ==== cluster BboxPoints
C = ClusterInput()
bbox = BoundingBox(Content=C, Plane=PlaneXY(0, 0, 0), UnionBox=True)  # -> Box, Box_2
explode = BrepComponents(Brep=bbox.Box)  # -> Faces, Edges, Vertices
pcen = PolygonCenter(Polyline=explode.Faces)  # -> CenterV, CenterE
item = ListItem(List=pcen.CenterV, Index=Slider(5, range=0..12), Wrap=False)
item_2 = ListItem(List=pcen.CenterV, Index=Slider(3, range=0..12), Wrap=False)
item_3 = ListItem(List=pcen.CenterV, Index=Slider(1, range=0..12), Wrap=False)
subtraction = Subtraction(A=item_2, B=item_3)
pcomp = Decompose(Point=subtraction, System=PlaneXY(0, 0, 0))  # -> XComponent, YComponent, ZComponent
item_4 = ListItem(List=pcen.CenterV, Index=Slider(0, range=0..12), Wrap=False)
item_5 = ListItem(List=pcen.CenterV, Index=Slider(2, range=0..12), Wrap=False)
subtraction_2 = Subtraction(A=item_5, B=item_4)
pcomp_2 = Decompose(Point=subtraction_2, System=PlaneXY(0, 0, 0))  # -> XComponent, YComponent, ZComponent
abs = Absolute(Value=pcomp.XComponent)
abs_2 = Absolute(Value=pcomp_2.YComponent)
width = ClusterOutput(abs)
E = ClusterOutput(item_4)
E_2 = ClusterOutput(item_5)
center = ClusterOutput(item)
height = ClusterOutput(abs_2)
